# Grasshopper definition 20180427_Hyperboloid.gh (Grasshopper 1.0.5)

r1 = Slider(2.858, range=0..10)
r2 = Slider(3.161, range=0..10)
pt = ConstructPoint(XCoordinate=0, YCoordinate=0, ZCoordinate=Slider(5.339, range=0..10))
number_slider = Slider(32, range=0..100)
cir = Circle(Plane=pt, Radius=r2)
cir_2 = Circle(Plane=PlaneXY(0, 0, 0), Radius=r1)
rotate = Rotate(Geometry=cir, Angle=Slider(1.862, range=0..6), Plane=PlaneXY(0, 0, 0))  # -> Geometry, Transform
divide = DivideCurve(Curve=rotate.Geometry, Count=number_slider, Kinks=False)  # -> Points, Tangents, Parameters
divide_2 = DivideCurve(Curve=cir_2, Count=number_slider, Kinks=False)  # -> Points, Tangents, Parameters
ln = Line(StartPoint=divide_2.Points, EndPoint=divide.Points)
loft = Loft(Curves=ln, Options={Adjust=False, Closed=True, LoftEnds=0, LoftSimp=0, LoftType=0, Rebuild=10, Refit=0.01})
