# Grasshopper definition 20180427_Tubes_V02.gh (Grasshopper 1.0.5)

rectangle = Rectangle(Plane=PlaneXY(0, 0, 0), XSize=Slider(500, range=0..10000), YSize=Slider(1000, range=0..10000), Radius=0)  # -> Rectangle, Length
pop2d = Populate2D(Region=rectangle.Rectangle, Count=Slider(8, range=0..100), Seed=Slider(36, range=0..100))

# ---- group: option 2
avr = Average(Input=pop2d)
cir = Circle(Plane=avr, Radius=100)
alongcrv = SortAlongCurve(Points=pop2d, Curve=cir)  # -> Points, Indices
pline = PolyLine(Vertices=alongcrv.Points, Closed="true")
geo = Geometry(pline)

# ---- group: option 1
hull = ConvexHull(Points=pop2d, Plane=PlaneXY(0, 0, 0))  # -> Hull, HullZ, Indices

# ----
geo_polyline = Geometry(geo)

Z = UnitZ(Factor=Slider(0, range=0..1000))
move = Move(Geometry=geo_polyline, Motion=Z)  # -> Geometry, Transform
explode = Explode(Curve=move.Geometry, Recursive=True)  # -> Segments, Vertices
eval = EvaluateCurve(Curve=reparameterize(explode.Segments), Parameter=Slider(0.912, range=0..1))  # -> Point, Tangent, Angle
eval_2 = EvaluateCurve(Curve=reparameterize(explode.Segments), Parameter=Slider(0.082, range=0..1))  # -> Point, Tangent, Angle
weave = Weave(Pattern=[0, 1], Stream0=eval_2.Point, Stream1=eval.Point, NullGaps=False)
pline_2 = PolyLine(Vertices=weave, Closed="true")

Z_2 = UnitZ(Factor=Slider(258, range=0..1000))
move_2 = Move(Geometry=geo_polyline, Motion=Z_2)  # -> Geometry, Transform
explode_2 = Explode(Curve=move_2.Geometry, Recursive=True)  # -> Segments, Vertices
eval_3 = EvaluateCurve(Curve=reparameterize(explode_2.Segments), Parameter=Slider(0.596, range=0..1))  # -> Point, Tangent, Angle
eval_4 = EvaluateCurve(Curve=reparameterize(explode_2.Segments), Parameter=Slider(0.31, range=0..1))  # -> Point, Tangent, Angle
weave_2 = Weave(Pattern=[0, 1], Stream0=eval_4.Point, Stream1=eval_3.Point, NullGaps=False)
pline_3 = PolyLine(Vertices=weave_2, Closed="true")

explode_3 = Explode(Curve=pline_3, Recursive=True)  # -> graft(Segments), Vertices
explode_4 = Explode(Curve=pline_2, Recursive=True)  # -> graft(Segments), Vertices
loft = Loft(
    Curves=[explode_4.Segments, explode_3.Segments],
    Options={Adjust=False, Closed=False, LoftEnds=0, LoftSimp=0, LoftType=0, Rebuild=10, Refit=0.01})
join = BrepJoin(Breps=flatten(loft))  # -> Breps, Closed
cap = CapHoles(Brep=join.Breps)
brep = Brep(cap)

# ---- group: Eliminate Ground Lines
brep_2 = Brep(brep)
edges = BrepEdges(Brep=brep_2)  # -> Naked, Interior, NonManifold
eval_5 = EvaluateCurve(Curve=reparameterize(edges.Interior), Parameter=0.5)  # -> Point, Tangent, Angle
pdecon = Deconstruct(Point=eval_5.Point)  # -> XComponent, YComponent, ZComponent
equals = Equality(FirstNumber=pdecon.ZComponent, SecondNumber="0")  # -> Equality, Inequality
sift = SiftPattern(List=edges.Interior, SiftPattern=equals.Equality)  # -> Output0, Output1
crv = Curve(sift.Output0)
clean = CleanTree(RemoveNulls=True, RemoveInvalid=True, RemoveEmpty=False, Tree=crv)
geo_2 = Geometry(clean)

# ---- group: Evaluate Length
geo_3 = Geometry(geo_2)
end = EndPoints(Curve=geo_3)  # -> Start, End
pdecon_2 = Deconstruct(Point=end.Start)  # -> XComponent, YComponent, ZComponent
pdecon_3 = Deconstruct(Point=end.End)  # -> XComponent, YComponent, ZComponent
equals_2 = Equality(FirstNumber=pdecon_2.ZComponent, SecondNumber="0")  # -> Equality, Inequality
equals_3 = Equality(FirstNumber=pdecon_3.ZComponent, SecondNumber="0")  # -> Equality, Inequality
panel = Panel("""-20
0""")
bool = Boolean(equals_3.Equality)
bool_2 = Boolean(equals_2.Equality)
item = ListItem(List=panel, Index=bool, Wrap=True)
item_2 = ListItem(List=panel, Index=bool_2, Wrap=True)
ext = ExtendCurve(Curve=geo_3, Type=0, Start=item_2, End=item)

# ----
geo_4 = Geometry(sift.Output1)
clean_2 = CleanTree(RemoveNulls=True, RemoveInvalid=True, RemoveEmpty=False, Tree=geo_4)

# ---- group: reorder
join_2 = JoinCurves(Curves=clean_2, Preserve=False)
explode_5 = Explode(Curve=join_2, Recursive=True)  # -> Segments, Vertices

# ----
shift = ShiftList(List=explode_5.Segments, Shift=Slider(1, range=0..1), Wrap=True)
culln = CullNth(List=shift, CullFrequency=2)

merge = Merge(Data1=flatten(ext), Data2=flatten(culln))
join_3 = JoinCurves(Curves=merge, Preserve=False)
pipe = Pipe(Curve=join_3, Radius="5", Caps=0)

geo_5 = Geometry(pline_3)
geo_6 = Geometry(join_3)
cp = ControlPoints(Curve=geo_5)  # -> Points, Weights, Knots
cp_2 = ControlPoints(Curve=geo_6)  # -> flatten(Points), Weights, Knots
shift_2 = ShiftList(List=cp.Points, Shift=1, Wrap="false")
cps = ClosestPoints(Point=graft(shift_2), Cloud=cp_2.Points, Count=3)  # -> ClosestPoint, CPIndex, Distance
ln = Line(StartPoint=graft(shift_2), EndPoint=cps.ClosestPoint)
number_slider = Slider(3.987, range=0..100)
addition = Addition(A=Slider(0.01, range=0..0.01), B=number_slider)
sph = Sphere(Base=graft(shift_2), Radius=addition)  # -> simplify(Sphere)
pipe_2 = Pipe(Curve=ln, Radius=number_slider, Caps=1)  # -> simplify(Pipe)
pshift = ShiftPaths(Data=pipe_2, Offset=-1)
sunion = SolidUnion(Breps=[pshift, sph])

material = CreateMaterial(
    Diffuse=ColourSwatch(SwatchColor=RGB(255, 255, 255)),
    Specular=RGB(255, 255, 255),
    Emission=RGB(0, 0, 0),
    Transparency=0,
    Shine=0)
preview = CustomPreview(Geometry=pipe, Material=material)
