# Grasshopper definition 20180518_Lists.gh (Grasshopper 1.0.5)

pt = Point([Point(-30.64429186, -11.76264326, 0), Point(-23.17057233, -21.61234559, 0), Point(-4.870976554, -25.09756025, 0), Point(1.460874543, -33.07396769, 0)])
pt_2 = Point(Point(-5.856324672, 1.843566298, 0))
series = Series(Start=Slider(545, range=0..1000), Step=1, Count=Slider(5, range=0..10))
panel = Panel(series)
ln = Line(StartPoint=pt_2, EndPoint=pt)
recgrid = Rectangular(
    Plane=PlaneXY(0, 0, 0),
    SizeX=Slider(4.771, range=0..10),
    SizeY=Slider(3.753, range=0..10),
    ExtentX=Slider(4, range=0..10),
    ExtentY=Slider(3, range=0..10))  # -> Cells, Points
lng = ListLength(List=panel)
panel_2 = Panel("""-1,-1,1
1,-1,1
1,1,1
-1,1,1""")
panel_3 = Panel(ln)
geo = Geometry(recgrid.Points)
panel_4 = Panel(lng)
graft = GraftTree(Tree=geo, IncludeEmptyLists=True, IncludeNullItems=True)
series_2 = Series(Start=series, Step=1, Count=Slider(3, range=0..10))
move = Move(Geometry=graft, Motion=panel_2)  # -> Geometry, Transform
panel_5 = Panel(series_2)
ln_2 = Line(StartPoint=graft, EndPoint=move.Geometry)
panel_6 = Panel(move.Geometry)
tstat = TreeStatistics(Tree=panel_5)  # -> Paths, Length, Count
divide = DivideCurve(Curve=ln_2, Count=Slider(4, range=0..10), Kinks=False)  # -> Points, Tangents, Parameters
viewer = ParamViewer(series_2)
path_mapper = PathMapper(divide.Points, source="{A;B;C;D;E}(i)", target="{A;B;D;C;i}(E)")
panel_7 = Panel(tstat.Length)
panel_8 = Panel(tstat.Paths)
panel_9 = Panel(tstat.Count)
panel_10 = Panel(ln_2)
panel_11 = Panel(divide.Points)
pline = PolyLine(Vertices=path_mapper, Closed="true")
pshift = ShiftPaths(Data=pline, Offset="-2")
panel_12 = Panel(pline)
bbox = BoundingBox(Content=pshift, Plane=PlaneXY(0, 0, 0), UnionBox=True)  # -> Box, Box_2

# ---- group: homework
viewer_2 = ParamViewer(pline)
graft_2 = GraftTree(IncludeEmptyLists=True, IncludeNullItems=True)
flatten = FlattenTree(Tree=pline, Path="{0}")
pshift_2 = ShiftPaths(Offset=-1)
entwine = Entwine(FlattenInputs=True)
flip = FlipMatrix(Data=geo)
bang = ExplodeTree()  # -> Branch0, Branch1
panel_13 = Panel(viewer_2)
branch = TreeBranch(MaintainPaths=True)

# ----
panel_14 = Panel(flatten)
