# Grasshopper definition tubes_v1.gh (Grasshopper 1.0.5)

brep = Brep(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)

# ---- group: Eliminate Ground Lines
edges = BrepEdges(Brep=brep)  # -> Naked, Interior, NonManifold
eval = EvaluateCurve(Curve=reparameterize(edges.Interior), Parameter=0.5)  # -> Point, Tangent, Angle
pdecon = Deconstruct(Point=eval.Point)  # -> XComponent, YComponent, ZComponent
equals = Equality(FirstNumber=pdecon.ZComponent, SecondNumber="0")  # -> Equality, Inequality
sift = SiftPattern(List=edges.Interior, SiftPattern=equals.Equality)  # -> Output0, Output1
crv = Curve(sift.Output0)
clean = CleanTree(RemoveNulls=True, RemoveInvalid=True, RemoveEmpty=False, Tree=crv)

# ----
number_slider = Slider(69, range=0..100)

# ---- group: Evaluate Length
end = EndPoints(Curve=clean)  # -> Start, End
pdecon_2 = Deconstruct(Point=end.Start)  # -> XComponent, YComponent, ZComponent
pdecon_3 = Deconstruct(Point=end.End)  # -> XComponent, YComponent, ZComponent
equals_2 = Equality(FirstNumber=pdecon_2.ZComponent, SecondNumber="0")  # -> Equality, Inequality
equals_3 = Equality(FirstNumber=pdecon_3.ZComponent, SecondNumber="0")  # -> Equality, Inequality
panel = Panel("""-20
0""")
bool = Boolean(equals_3.Equality)
bool_2 = Boolean(equals_2.Equality)
item = ListItem(List=panel, Index=bool_2, Wrap=True)
item_2 = ListItem(List=panel, Index=bool, Wrap=True)
ext = ExtendCurve(Curve=clean, Type=0, Start=item, End=item_2)

# ----
pipe = Pipe(Curve=ext, Radius="5", Caps=0)
